# Grasshopper definition SplitAtCorners.gh (Grasshopper 0.9.76)
# plug-ins: Kangaroo2 Components

B = Boundary({Plane=PlaneXY(0, 0, 0), Size=Domain2(u=-10..10, v=-10..10)})
mplane = MeshPlane(Boundary=B, WidthCount=10, HeightCount=10)  # -> Mesh, Area
medges = MeshEdges(Mesh=mplane.Mesh)  # -> NakedEdges, InteriorEdges, NonManifoldEdges
# Note that the angle is between consecutive segments in the same direction. So 0 is a straight line
crv = Curve(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)
join = JoinCurves(Curves=medges.NakedEdges, Preserve=False)
splitatcorners = SplitAtCorners(Poly=crv, Angle=Slider(1.039, range=0..3.141))  # -> Corners, Parts
splitatcorners_2 = SplitAtCorners(Poly=join, Angle=1)  # -> Corners, Parts
item = ListItem(List=splitatcorners_2.Parts, Index=0, Wrap=True)
pt = Point(splitatcorners.Corners)
pt_2 = Point(splitatcorners_2.Corners)
pipe = Pipe(Curve=item, Radius=1, Caps=0)
