# Grasshopper definition Catenary2.gh (Grasshopper 0.9.76)
# plug-ins: Kangaroo2 Components

mplane = MeshPlane(Boundary={Plane=PlaneXY(0, 0, 0), Size=Domain2(u=-10..10, v=-10..10)}, WidthCount=10, HeightCount=10)  # -> Mesh, Area
corners = Corners(mesh=mplane.Mesh)
edgelengths = EdgeLengths(Mesh=mplane.Mesh, LengthFactor=1, Strength=10)
vertexloads = VertexLoads(Mesh=mplane.Mesh, Strength=Slider(1, range=0.5..10))
grab = Grab(On=True, Strength=1, Range=3)  # -> Grab, Anchors
reset = Button()
anchor = Anchor(Point=corners, Strength=1000)
solver = Solver(GoalObjects=[anchor, grab.Grab, edgelengths, vertexloads], Reset=reset, Threshold=1e-15, Tolerance=0.01, On=True)  # -> I, V, O
data = Data(solver.O)

# ==== cluster Corners: Find the boundary corner points of a quad mesh
mesh = ClusterInput()
mesh_2 = Mesh(mesh)
nv = NakedVertices(Mesh=mesh_2)  # -> ClothedIndex, NakedIndex, ClothedPts, NakedPts
vn = VertexNeighbours(Mesh=mesh_2, VertexNumber=nv.NakedIndex)  # -> graft(Vertex), Neighbours, Normal
lng = ListLength(List=vn.Neighbours)
equals = Equality(FirstNumber=lng, SecondNumber=3)  # -> Equality, Inequality
cull = CullPattern(List=vn.Vertex, CullPattern=equals.Inequality)
pshift = ShiftPaths(Data=cull, Offset=-1)
D = ClusterOutput(pshift)
