# Grasshopper definition Catenary_slide.gh (Grasshopper 0.9.76)
# plug-ins: Kangaroo2 Components

W = WidthCount(20)
mplane = MeshPlane(Boundary={Plane=PlaneXY(0, 0, 0), Size=Domain2(u=-10..10, v=-10..10)}, WidthCount=W, HeightCount=W)  # -> Mesh, Area
medges = MeshEdges(Mesh=mplane.Mesh)  # -> NakedEdges, InteriorEdges, NonManifoldEdges
demesh = DeconstructMesh(Mesh=mplane.Mesh)  # -> Vertices, Faces, Colours, Normals
pt = Point([Point(10, 10, 0), Point(-10, 10, 0), Point(10, 9, 0), Point(-10, 9, 0), Point(10, 8, 0), Point(-10, 8, 0), Point(10, 7, 0), Point(-10, 7, 0), Point(10, 6, 0), Point(-10, 6, 0)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])
crv = Curve([medges.NakedEdges, medges.InteriorEdges])
anchorxyz = AnchorXYZ(Point=pt, X=False, Y=False, Z=True, Strength=1000)
pt_2 = Point(demesh.Vertices)
corners = Corners(mesh=mplane.Mesh)
len = Length(Curve=crv)
load = Load(Point=demesh.Vertices, ForceVector=Vector(0, 0, 1))
reset = Button()
multiplication = Multiplication(A=len, B=Slider(0.66, range=0..1))
anchor = Anchor(Point=corners, Strength=1000)
grab = Grab(On=True, Strength=1, Range=3)  # -> Grab, Anchors
length_line = LengthLine(Line=crv, Length=multiplication, Strength=10)
solver = Solver(GoalObjects=[anchor, length_line, load, grab.Grab, anchorxyz], Reset=reset, Threshold=1e-15, Tolerance=0.01, On=True)  # -> I, V, O
clean = CleanTree(RemoveNulls=True, RemoveInvalid=True, RemoveEmpty=False, Tree=solver.O)
data = Data(solver.O)
len_2 = Length(Curve=clean)
sort = SortList(Keys=len_2)  # -> Keys, ValuesA
panel = Panel(sort.Keys)

# ==== cluster Corners: Find the boundary corner points of a quad mesh
mesh = ClusterInput()
mesh_2 = Mesh(mesh)
nv = NakedVertices(Mesh=mesh_2)  # -> ClothedIndex, NakedIndex, ClothedPts, NakedPts
vn = VertexNeighbours(Mesh=mesh_2, VertexNumber=nv.NakedIndex)  # -> graft(Vertex), Neighbours, Normal
lng = ListLength(List=vn.Neighbours)
equals = Equality(FirstNumber=lng, SecondNumber=3)  # -> Equality, Inequality
cull = CullPattern(List=vn.Vertex, CullPattern=equals.Inequality)
pshift = ShiftPaths(Data=cull, Offset=-1)
D = ClusterOutput(pshift)
