# Grasshopper definition CirclePackOnSurface.gh (Grasshopper 0.9.76)
# plug-ins: Kangaroo2 Components

# ---- group: try increasing either until the circles fill the surface
number_slider = Slider(0.607, range=0..2)
number_slider_2 = Slider(338, range=1..1000)

# ----
srf = Surface(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)
popgeo = PopulateGeometry(Geometry=srf, Count=number_slider_2, Seed=1)
onmesh = OnMesh(Points=popgeo, Mesh=srf, Strength=1)
sc = SphereCollide(Points=popgeo, Radius=number_slider, Strength=1)
show = Show(G=popgeo)
solver = Solver(GoalObjects=[onmesh, sc, show], Reset=Button(), Threshold=1e-15, Tolerance=0.01, On=True)  # -> I, V, O
srf_cp = SurfaceClosestPoint(Point=solver.O, Surface=srf)  # -> Point, UVPoint, Distance
evalsrf = EvaluateSurface(Surface=srf, Point=srf_cp.UVPoint)  # -> Point, Normal, Frame
cir = Circle(Plane=evalsrf.Frame, Radius=number_slider)
