# Grasshopper definition CurveParticleCollide2d.gh (Grasshopper 0.9.76)
# plug-ins: Kangaroo2 Components

pt = Point([Point(-8, 34.30562263, 0), Point(9.52496961, 20.01699977, 0), Point(24.76432048, 11.02350394, 0), Point(13.49169548, -3.478222673, 0), Point(45.96791286, -18.42056565, 0), Point(47.66656448, 2.624432507, 0), Point(79.40037141, 13.60921183, 0), Point(30.57912998, -45.58654341, 0)])
pop2d = Populate2D(Region={Plane=PlaneXY(0, 27, 0), Size=Domain2(u=0..24, v=0..12)}, Count=80, Seed=1)
Y = UnitY(Factor=-0.01)
intcrv = Interpolate(Vertices=pt, Degree=3, Periodic=True, KnotStyle=1)  # -> Curve, Length, Domain
offset = Offset(Curve=intcrv.Curve, Distance=-1, Plane=PlaneXY(0, 0, 0), Corners=1)
boundary = BoundarySurfaces(Edges=intcrv.Curve)
reset = Button()
on = BooleanToggle(True)
cpc = CurvePointCollide(Points=pop2d, Curve=offset, Plane=PlaneXY(0, 0, 0), Interior=Toggle(False), Strength=10)
onplane = OnPlane(Points=pop2d, Plane=PlaneXY(0, 0, 0), Strength=1)
sc = SphereCollide(Points=pop2d, Radius=1, Strength=10)
load = Load(Point=pop2d, ForceVector=Y)
solver = Solver(GoalObjects=[sc, cpc, load, onplane], Reset=reset, Threshold=1e-15, Tolerance=0.01, On=on)  # -> I, V, O
cloud = CloudDisplay(Points=solver.V, Colours=RGB(35, 55, 186), Size=1.1, SpriteType=1)
