# Grasshopper definition cableCollide.gh (Grasshopper 1.0.8)

crv = Curve([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])
divide = DivideCurve(Curve=crv, Count=10, Kinks=False)  # -> Points, Tangents, Parameters
shatter = Shatter(Curve=graft(crv), Parameters=divide.Parameters)  # -> flatten(Segments)
line = Line(shatter)
grab = Grab(On=True, Strength=1, Range=3)
collider = Collider(Objects=line, Radii=0.2, Strength=1)
length_line = LengthLine(Line=line, Strength=10)
solver = Solver(GoalObjects=[collider, length_line, grab], Reset=Button(), Threshold=1e-15, Tolerance=0.01, On=True)  # -> I, V, O
