# Grasshopper definition cloth_inflatable_collision.gh (Grasshopper 1.0.4)
# plug-ins: Kangaroo2 Components

mesh = Mesh(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)
mesh_2 = Mesh(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)
tri = Triangulate(Mesh=mesh)  # -> Mesh, Count
tri_2 = Triangulate(Mesh=mesh_2)  # -> Mesh, Count
clean = CombineClean(Meshes=tri.Mesh)
demesh = DeconstructMesh(Mesh=tri_2.Mesh)  # -> Vertices, Faces, Colours, Normals
show = Show(G=tri_2.Mesh)
show_2 = Show(G=clean)

# ---- group: preserving volume, and decreasing edge lengths for balloon
medges = MeshEdges(Mesh=clean)  # -> NakedEdges, InteriorEdges, NonManifoldEdges
volume = Volume(Mesh=clean, Strength=0.1)
length_line = LengthLine(Line=medges.InteriorEdges, Length=0, Strength=0.1)

# ----
medges_2 = MeshEdges(Mesh=tri_2.Mesh)  # -> NakedEdges, InteriorEdges, NonManifoldEdges
Z = UnitZ(Factor=-0.1)

# ---- group: cloth self-collision using spheres
sc = SphereCollide(Points=demesh.Vertices, Radius=1.7, Strength=1)

# ---- group: 2-way collision between balloon and cloth
spc = SolidPointCollide(Points=demesh.Vertices, Solid=clean, Interior=False, Unidirectional=False, Strength=1)

# ----
load = Load(Point=demesh.Vertices, ForceVector=Z)
floor = Floor(Strength=1)
grab = Grab(On=True, Strength=1, Range=3)  # -> Grab, Anchors
length_line_2 = LengthLine(Line=[medges_2.InteriorEdges, medges_2.NakedEdges], Strength=10)
entwine = Entwine(
    Branch00=[length_line_2, load, floor, volume, spc, length_line, sc, grab.Grab],
    Branch01=show,
    Branch02=show_2,
    FlattenInputs=True)
solver = Solver(GoalObjects=entwine, Reset=Button(), Threshold=1e-15, Tolerance=0.01, On=Toggle(True))  # -> I, V, O
bang = ExplodeTree(Data=solver.O)  # -> Branch0, Branch1, Branch2
preview = CustomPreview(
    Geometry=bang.Branch1,
    Material=[{diffuse=RGB(255, 20, 147), emission=RGB(76, 6, 44), shine=0.5, specular=RGB(255, 255, 255), transparency=0}, {diffuse=RGB(0, 192, 0), emission=RGB(0, 0, 0), shine=0.5, specular=RGB(255, 255, 255), transparency=0}])
preview_2 = CustomPreview(
    Geometry=bang.Branch2,
    Material={diffuse=RGB(255, 20, 147), emission=RGB(76, 6, 44), shine=0.5, specular=RGB(255, 255, 255), transparency=0})
