# Grasshopper definition clothcollide.gh (Grasshopper 0.9.76)
# plug-ins: Weaverbird, Kangaroo2 Components

mplane = MeshPlane(Boundary={Plane=PlaneXY(0, 0, 0), Size=Domain2(u=-10..10, v=-10..10)}, WidthCount=10, HeightCount=10)  # -> Mesh, Area
demesh = DeconstructMesh(Mesh=mplane.Mesh)  # -> Vertices, Faces, Colours, Normals
medges = MeshEdges(Mesh=mplane.Mesh)  # -> NakedEdges, InteriorEdges, NonManifoldEdges
show = Show(G=mplane.Mesh)
sc = SphereCollide(Points=demesh.Vertices, Radius=1, Strength=1)
length_line = LengthLine(Line=[medges.NakedEdges, medges.InteriorEdges], Strength=10)
grab = Grab(On=True, Strength=1, Range=3)  # -> Grab, Anchors
solver = Solver(GoalObjects=[sc, length_line, grab.Grab, show], Reset=False, Threshold=1e-15, Tolerance=0.01, On=True)  # -> I, V, O
data = Data(solver.O)
wbcatmullclark = WeaverbirdsCatmullClarkSubdivision(MeshCurves=data, Level=3, SmoothNakedEdges=2)
