# Grasshopper definition drape.gh (Grasshopper 0.9.76)
# plug-ins: Kangaroo2 Components

W = WidthCount(30)
mplane = MeshPlane(Boundary={Plane=PlaneXY(-15, -10, 7), Size=Domain2(u=0..40, v=0..40)}, WidthCount=W, HeightCount=W)  # -> Mesh, Area
demesh = DeconstructMesh(Mesh=mplane.Mesh)  # -> Vertices, Faces, Colours, Normals
medges = MeshEdges(Mesh=mplane.Mesh)  # -> NakedEdges, InteriorEdges, NonManifoldEdges
brep = Brep(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)
Z = UnitZ(Factor=-0.1)
crv = Curve([medges.NakedEdges, medges.InteriorEdges])
floor = Floor(Strength=1)
length_line = LengthLine(Line=crv, Strength=10)
spc = SolidPointCollide(Points=demesh.Vertices, Solid=brep, Interior=False, Unidirectional="True", Strength=1)
load = Load(Point=demesh.Vertices, ForceVector=Z)
solver = Solver(GoalObjects=[length_line, spc, floor, load], Reset=Button(), Threshold=1e-15, Tolerance=0.01, On=Toggle(False))  # -> I, V, O
data = Data(solver.O)
