# Grasshopper definition origami_springs_only.gh (Grasshopper 1.0.4)
# plug-ins: Kangaroo2 Components

# Here is a simpler way to simulate origami,
# simply by preserving edge lengths and
# diagonals. However this approach is usually
# not suitable for more complex patterns
mesh = Mesh(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)
faceb = FaceBoundaries(Mesh=mesh)
medges = MeshEdges(Mesh=mesh)  # -> NakedEdges, InteriorEdges, NonManifoldEdges
explode = Explode(Curve=faceb, Recursive=True)  # -> Segments, Vertices
item = ListItem(List=explode.Vertices, Index=0, Wrap=True)  # -> Item, Item1, Item2, Item3
ln = Line(StartPoint=item.Item1, EndPoint=item.Item3)
ln_2 = Line(StartPoint=item.Item, EndPoint=item.Item2)
grab = Grab(On=True, Strength=1, Range=3)  # -> Grab, Anchors
length_line = LengthLine(Line=[medges.NakedEdges, medges.InteriorEdges, ln_2, ln], Strength=10)
show = Show(G=mesh)
solver = Solver(GoalObjects=[length_line, grab.Grab, show], Reset=Button(), Threshold=1e-15, Tolerance=0.01, On=True)  # -> I, V, O
