# Grasshopper definition Cyclic_quad.gh (Grasshopper 0.9.76)
# plug-ins: Kangaroo2 Components

mesh = Mesh(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)
faceb = FaceBoundaries(Mesh=mesh)
explode = Explode(Curve=faceb, Recursive=True)  # -> Segments, Vertices
cullpt = CullDuplicates(Points=flatten(explode.Vertices), Tolerance=0.1, CullMode=3)  # -> Points, Indices, Valence
item = ListItem(List=explode.Vertices, Index=0, Wrap=True)  # -> Item, Item1, Item2, Item3
cyclicquad = CyclicQuad(P0=item.Item, P1=item.Item1, P2=item.Item2, P3=item.Item3, Strength=1)
grab = Grab(On=True, Strength=1, Range=3)  # -> Grab, Anchors
show = Show(G=mesh)
onplane = OnPlane(Points=cullpt.Points, Plane=PlaneXY(0, 0, 0), Strength=1)
solver = Solver(GoalObjects=[grab.Grab, show, cyclicquad, onplane], Reset=Button(), Threshold=1e-15, Tolerance=0.01, On=True)  # -> I, V, O
item_2 = ListItem(List=solver.O, Index=0, Wrap=True)
mesh_2 = Mesh(item_2)
clean = CleanTree(RemoveNulls=True, RemoveInvalid=True, RemoveEmpty=False, Tree=item_2)
tri = Triangulate(Mesh=mesh_2)  # -> Mesh, Count
facec = FaceCircles(Mesh=tri.Mesh)  # -> Centers, Ratio
