# Grasshopper definition british_museum.gh (Grasshopper 0.9.76)
# plug-ins: Kangaroo2 Components

mesh = Mesh(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)
medges = MeshEdges(Mesh=mesh)  # -> NakedEdges, InteriorEdges, NonManifoldEdges
demesh = DeconstructMesh(Mesh=mesh)  # -> Vertices, Faces, Colours, Normals
mesh_2 = Mesh(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)
join = JoinCurves(Curves=medges.NakedEdges, Preserve=False)
len = Length(Curve=join)
sort = SortList(Keys=len, ValuesA=join)  # -> Keys, ValuesA
show = Show(G=mesh)
onmesh = OnMesh(Points=demesh.Vertices, Mesh=mesh_2, Strength=1)
mc = MeshCorners(Mesh=mesh, Angle=2.35619449)
length_line = LengthLine(Line=[medges.InteriorEdges, medges.NakedEdges], Length=0, Strength=0.1)
item = ListItem(List=sort.ValuesA, Index=0, Wrap=True)  # -> Item, Item1
anchor = Anchor(Point=mc, Strength=10000)
crv = Curve(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)
crv_2 = Curve(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)
explode = Explode(Curve=item.Item, Recursive=True)  # -> Segments, Vertices
explode_2 = Explode(Curve=item.Item1, Recursive=True)  # -> Segments, Vertices
end = EndPoints(Curve=explode_2.Segments)  # -> Start, End
strength = Strength(1000)
end_2 = EndPoints(Curve=explode.Segments)  # -> Start, End
oncurve = OnCurve(Points=end_2.Start, Curve=crv_2, Strength=strength)
oncurve_2 = OnCurve(Points=end.Start, Curve=crv, Strength=strength)
solver = Solver(
    GoalObjects=[show, oncurve_2, oncurve, anchor, length_line, onmesh],
    Reset=Button(),
    Threshold=1e-15,
    Tolerance=0.01,
    On=Toggle(True))  # -> I, V, flatten(O)
item_2 = ListItem(List=solver.O, Index=0, Wrap=True)
