# Grasshopper definition gridrelax01.gh (Grasshopper 0.9.76)
# plug-ins: Kangaroo Components, Kangaroo2 Components

mesh = Mesh(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)
refine = Refine(Mesh=mesh, Level=3)
clean = CombineClean(Meshes=refine)
medges = MeshEdges(Mesh=clean)  # -> NakedEdges, InteriorEdges, NonManifoldEdges
join = JoinCurves(Curves=medges.NakedEdges, Preserve=False)
length_line = LengthLine(Line=[medges.InteriorEdges, medges.NakedEdges], Length=0, Strength=0.01)
item = ListItem(List=join, Index=0, Wrap=True)  # -> Item, Item1
show = Show(G=clean)
explode = Explode(Curve=item.Item, Recursive=True)  # -> Segments, Vertices
crv = Curve(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)
strength = Strength(1000)
end = EndPoints(Curve=explode.Segments)  # -> Start, End
oncurve = OnCurve(Points=end.Start, Curve=crv, Strength=strength)
solver = Solver(GoalObjects=[show, oncurve, length_line], Reset=Button(), Threshold=1e-15, Tolerance=0.01, On=Toggle(False))  # -> I, V, O
