# Grasshopper definition gridrelax02.gh (Grasshopper 0.9.76)
# plug-ins: Kangaroo Components, Kangaroo2 Components

mesh = Mesh(<mesh referenced from the Rhino model>)
refine = Refine(Mesh=mesh, Level=3)
clean = CombineClean(Meshes=refine)
medges = MeshEdges(Mesh=clean)  # -> NakedEdges, InteriorEdges, NonManifoldEdges
join = JoinCurves(Curves=medges.NakedEdges, Preserve=False)
item = ListItem(List=join, Index=0, Wrap=True)  # -> Item, Item1
length_line = LengthLine(Line=[medges.InteriorEdges, medges.NakedEdges], Length=0, Strength=0.01)
show = Show(G=clean)
explode = Explode(Curve=item.Item1, Recursive=True)  # -> Segments, Vertices
explode_2 = Explode(Curve=item.Item, Recursive=True)  # -> Segments, Vertices
strength = Strength(1000)
crv = Curve(<curve referenced from the Rhino model>)
strength_2 = Strength(1000)
crv_2 = Curve(<curve referenced from the Rhino model>)
end = EndPoints(Curve=explode.Segments)  # -> Start, End
end_2 = EndPoints(Curve=explode_2.Segments)  # -> Start, End
oncurve = OnCurve(Points=end.Start, Curve=crv, Strength=strength)
oncurve_2 = OnCurve(Points=end_2.Start, Curve=crv_2, Strength=strength_2)
solver = Solver(GoalObjects=[show, oncurve_2, length_line, oncurve], Reset=Button(), Threshold=1e-15, Tolerance=0.01, On=Toggle(True))  # -> I, V, O
data = Data(solver.O)
