# Grasshopper definition inflation.gh (Grasshopper 1.0.7)
# plug-ins: Kangaroo2 Components

W = WidthCount(6)
mbox = MeshBox(Base={Plane=PlaneXY(0, 0, 0), X=Domain(-10, 10), Y=Domain(-10, 10), Z=Domain(-10, 10)}, XCount=W, YCount=W, ZCount=W)

# ---- group: Pressure works with triangulated meshes
tri = Triangulate(Mesh=mbox)  # -> Mesh, Count

# ----
mesh = Mesh(tri.Mesh)
clean = CombineClean(Meshes=mesh)
medges = MeshEdges(Mesh=clean)  # -> NakedEdges, InteriorEdges, NonManifoldEdges

# ---- group: this lets you drag points in the Rhino window
grab = Grab(On=True, Strength=1, Range=3)

# ----
on = BooleanToggle(True)
reset = Button()
pressure = Pressure(M=clean, Strength=0.01)
length_line = LengthLine(Line=medges.InteriorEdges, Strength=5)
show = Show(G=clean)
entwine = Entwine(Branch00=show, Branch01=[length_line, pressure, grab], FlattenInputs=True)
solver = Solver(GoalObjects=entwine, Reset=reset, Threshold=1e-15, Tolerance=0.01, On=on)  # -> I, V, O
bang = ExplodeTree(Data=solver.O)  # -> Branch0, Branch1
mesh_2 = Mesh(bang.Branch0)
