# Grasshopper definition volume_example.gh (Grasshopper 1.0.7)
# plug-ins: Kangaroo2 Components

# ---- group: boundary curve
crv = Curve(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)

# ----
mesh = Mesh(crv)
triremesh = TriRemesh(Geometry=mesh, Length=1, Iterations=25)  # -> Triangulation, Dual, Creases
nv = NakedVertices(Mesh=triremesh.Triangulation)  # -> ClothedIndex, NakedIndex, ClothedPts, NakedPts
edgelengths = EdgeLengths(Mesh=triremesh.Triangulation, LengthFactor=Slider(0.67, range=0..1), Strength=1)
volume = Volume(Mesh=triremesh.Triangulation, Volume=Slider(6052.308, range=0..20101), Strength=1)
anchor = Anchor(Point=nv.NakedPts, Strength=10000)
show = Show(G=triremesh.Triangulation)
entwine = Entwine(Branch00=show, Branch01=[anchor, volume, edgelengths], FlattenInputs=True)
solver = Solver(GoalObjects=entwine, Reset=Button(), Threshold=1e-15, Tolerance=0.01, On=Toggle(False))  # -> I, V, O
bang = ExplodeTree(Data=solver.O)  # -> Branch0, Branch1
mesh_2 = Mesh(bang.Branch0)
preview = CustomPreview(
    Geometry=mesh_2,
    Material={diffuse=RGB(0, 128, 0), emission=RGB(0, 0, 0), shine=0.5, specular=RGB(255, 255, 255), transparency=0.1})
