# Grasshopper definition mechanical_assembly.gh (Grasshopper 0.9.76)
# plug-ins: Kangaroo2 Components

brep = Brep(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)
brep_2 = Brep(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)
brep_3 = Brep(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)
debrep = DeconstructBrep(Brep=brep)  # -> Faces, Edges, Vertices
debrep_2 = DeconstructBrep(Brep=brep_2)  # -> Faces, Edges, Vertices
debrep_3 = DeconstructBrep(Brep=brep_3)  # -> Faces, Edges, Vertices
rigidbody = RigidBody(Part=graft(brep), Points=debrep.Vertices, Strength=10)  # -> RigidBody, Planes
rigidbody_2 = RigidBody(Part=graft(brep_3), Points=debrep_3.Vertices, Strength=10)  # -> RigidBody, Planes
rigidbody_3 = RigidBody(Part=graft(brep_2), Points=debrep_2.Vertices, Strength=10)  # -> RigidBody, Planes
crv = Curve(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)
crv_2 = Curve(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)
facea = FaceA(PlaneXY(-18, -1.5, 4))
faceb = FaceB(PlaneXY(-3, -2, 4))
crv_3 = Curve(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)
crv_4 = Curve(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)
facea_2 = FaceA(Plane(origin=(8, -2, 15), x=(0, 0, 1), y=(0, 1, 0)))
faceb_2 = FaceB(PlaneXY(32, -1.5, 4))
concentric = Concentric(PlaneA=rigidbody.Planes, PlaneB=rigidbody_3.Planes, AxisA=crv, AxisB=crv_2, Flip=Toggle(False), Strength=1)
alignfaces = AlignFaces(PlaneA=rigidbody.Planes, PlaneB=rigidbody_3.Planes, FaceA=facea, FaceB=faceb, Flip=Toggle(False), Strength=1)
concentric_2 = Concentric(PlaneA=rigidbody_3.Planes, PlaneB=rigidbody_2.Planes, AxisA=crv_3, AxisB=crv_4, Flip=Toggle(False), Strength=1)
alignfaces_2 = AlignFaces(PlaneA=rigidbody_3.Planes, PlaneB=rigidbody_2.Planes, FaceA=facea_2, FaceB=faceb_2, Flip=Toggle(False), Strength=1)

reset = Button()
grab = Grab(On=True, Strength=0.1, Range=1)  # -> Grab, Anchors

solver = Solver(
    GoalObjects=[rigidbody.RigidBody, grab.Grab, concentric, rigidbody_3.RigidBody, alignfaces, rigidbody_2.RigidBody, concentric_2, alignfaces_2],
    Reset=reset,
    Threshold=1e-15,
    Tolerance=0.01,
    On=Toggle(True))  # -> I, V, O
colourful = Colourful(geo=solver.O)

# ==== cluster Colourful: Display objects in bright colours
geo = ClusterInput()
geo_2 = Geometry(geo)
clean = CleanTree(RemoveNulls=True, RemoveInvalid=True, RemoveEmpty=False, Tree=flatten(geo_2))
S = Shader([{ambient=RGB(128, 128, 128), diffuse=RGB(11, 125, 222), emission=RGB(3, 38, 67), shine=0.5, specular=RGB(255, 255, 255), transparency=0}, {ambient=RGB(128, 128, 128), diffuse=RGB(222, 37, 11), emission=RGB(67, 11, 3), shine=0.5, specular=RGB(255, 255, 255), transparency=0}, {ambient=RGB(128, 128, 128), diffuse=RGB(71, 222, 11), emission=RGB(21, 67, 3), shine=0.5, specular=RGB(255, 255, 255), transparency=0}, {ambient=RGB(128, 128, 128), diffuse=RGB(222, 194, 11), emission=RGB(67, 58, 3), shine=0.5, specular=RGB(255, 255, 255), transparency=0}])
lng = ListLength(List=clean)
repeat = RepeatData(Data=S, Length=lng)
preview = CustomPreview(Geometry=clean, Shader=repeat)
