# Grasshopper definition strandbeest.gh (Grasshopper 0.9.76)
# plug-ins: Kangaroo Components, Kangaroo2 Components

button = Button()
timer = Timer(TimerInterval=20, Target=counter)  # disabled
crv = Curve([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])
pt = Point([Point(38.37953562, 63.10049538, 0), Point(63.35407149, 63.10049538, 0)])
pt_2 = Point(Point(45.96265117, 65.74097308, 0))
O = Origin(Point(50.86680355, 65.74098193, 0))
counter = Counter(Reset=button)
knob = ControlKnob(Decimals=2, Limit=False, Maximum=10, Minimum=0, Range=6.28, Value=0)
multiplication = Multiplication(A=counter, B=0.05)
xy = XYPlane(Origin=O)
rotate = Rotate(Geometry=pt_2, Angle=expr("-x", multiplication), Plane=xy)  # -> Geometry, Transform
length_line = LengthLine(Line=crv, Strength=1)
anchor = Anchor(Point=[pt, O], Strength=10000)
anchor_2 = Anchor(Point=pt_2, Target=rotate.Geometry, Strength=1)
solver = Solver(GoalObjects=[length_line, anchor, anchor_2], Reset=button, Threshold=1e-15, Tolerance=0.01, On=Toggle(True))  # -> I, V, O
item = ListItem(List=solver.V, Index=[3, 11], Wrap=True)
T = Trail(Points=item, Reset=button, Record=Toggle(False))
