# Grasshopper definition Catenary_galapagos.gh (Grasshopper 0.9.76)
# plug-ins: Kangaroo2 Components

number_slider = Slider(12.859, range=0..15)
mplane = MeshPlane(Boundary={Plane=PlaneXY(0, 0, 0), Size=Domain2(u=-10..10, v=-10..10)}, WidthCount=10, HeightCount=10)  # -> Mesh, Area
demesh = DeconstructMesh(Mesh=mplane.Mesh)  # -> Vertices, Faces, Colours, Normals
medges = MeshEdges(Mesh=mplane.Mesh)  # -> NakedEdges, InteriorEdges, NonManifoldEdges
corners = Corners(mesh=mplane.Mesh)
load = Load(Point=demesh.Vertices, ForceVector=Vector(0, 0, 1))
length_line = LengthLine(Line=[medges.NakedEdges, medges.InteriorEdges], Strength=number_slider)
anchor = Anchor(Point=corners, Strength=1000)
zombiesolver = ZombieSolver(GoalObjects=[anchor, length_line, load], Threshold=1e-10, Tolerance=0.01, MaxIterations=50000)  # -> I, V, O
pdecon = Deconstruct(Point=zombiesolver.V)  # -> XComponent, YComponent, ZComponent
data = Data(zombiesolver.O)
sort = SortList(Keys=pdecon.ZComponent)  # -> reverse(Keys), ValuesA
item = ListItem(List=sort.Keys, Index=0, Wrap=True)
panel = Panel(item)
num = Number(item)
subtraction = Subtraction(A=num, B="15")
num_2 = Number(subtraction)
panel_2 = Panel(subtraction)
abs = Absolute(Value=num_2)
galapagos = Galapagos(fitness=num_3, gene=number_slider)
num_3 = Number(abs)

# ==== cluster Corners: Find the boundary corner points of a quad mesh
mesh = ClusterInput()
mesh_2 = Mesh(mesh)
nv = NakedVertices(Mesh=mesh_2)  # -> ClothedIndex, NakedIndex, ClothedPts, NakedPts
vn = VertexNeighbours(Mesh=mesh_2, VertexNumber=nv.NakedIndex)  # -> graft(Vertex), Neighbours, Normal
lng = ListLength(List=vn.Neighbours)
equals = Equality(FirstNumber=lng, SecondNumber=3)  # -> Equality, Inequality
cull = CullPattern(List=vn.Vertex, CullPattern=equals.Inequality)
pshift = ShiftPaths(Data=cull, Offset=-1)
D = ClusterOutput(pshift)
