# Grasshopper definition Raisin.gh (Grasshopper 0.9.76)
# plug-ins: Weaverbird, Kangaroo2 Components

wbicosahedron = WeaverbirdsMeshMeshIcosahedron(Plane=PlaneXY(0, 0, 0), Radius=5)
wbloop = WeaverbirdsLoopSubdivision(MeshCurves=wbicosahedron, Level=3, SmoothNakedEdges=1)
mesh = Mesh(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)
medges = MeshEdges(Mesh=mesh)  # -> NakedEdges, InteriorEdges, NonManifoldEdges
volume = Volume(Geometry=mesh)  # -> Volume, Centroid
multiplication = Multiplication(A=Slider(0, range=0..1), B=volume.Volume)
len = Length(Curve=medges.InteriorEdges)
avr = Average(Input=len)
volume_2 = Volume(Mesh=mesh, Volume=multiplication, Strength=0.2)
length_line = LengthLine(Line=medges.InteriorEdges, Strength=1)
smooth = Smooth(M=mesh, Strength=0.1)
show = Show(G=mesh)
demesh = DeconstructMesh(Mesh=mesh)  # -> Vertices, Faces, Colours, Normals
multiplication_2 = Multiplication(A=avr, B=0.5)
sc = SphereCollide(Points=demesh.Vertices, Radius=multiplication_2, Strength=10)
reset = Button()
solver = Solver(GoalObjects=[volume_2, length_line, show, smooth, sc], Reset=reset, Threshold=1e-15, Tolerance=0.01, On=Toggle(False))  # -> I, V, O
item = ListItem(List=solver.O, Index=1, Wrap=True)
wbloop_2 = WeaverbirdsLoopSubdivision(MeshCurves=item, Level=2, SmoothNakedEdges=1)
preview = CustomPreview(
    Geometry=wbloop_2,
    Shader={ambient=RGB(128, 128, 128), diffuse=RGB(108, 44, 10), emission=RGB(64, 0, 0), shine=0.5, specular=RGB(255, 255, 255), transparency=0})
