# Grasshopper definition crumple_setlengths.gh (Grasshopper 0.9.76)
# plug-ins: Kangaroo2 Components

# This definition creates a regular triangular mesh, then randomly assigns 1 of 3 given lengths to each edge. After dragging it out of plane, this results in a crumpled looking mesh with only 3 different edge lengths.
trigrid = Triangular(Plane=PlaneXY(0, 0, 0), Size=1, ExtentX=15, ExtentY=8)  # -> Cells, Points
explode = Explode(Curve=trigrid.Cells, Recursive=True)  # -> Segments, Vertices
end = EndPoints(Curve=explode.Segments)  # -> Start, End
triangle = MeshTriangle(CornerA=0, CornerB=1, CornerC=2)
conmesh = ConstructMesh(Vertices=end.Start, Faces=triangle)  # -> flatten(Mesh)
clean = CombineClean(Meshes=conmesh)
medges = MeshEdges(Mesh=clean)  # -> NakedEdges, InteriorEdges, NonManifoldEdges
# The 3 edge lengths to choose from
panel = Panel("""0.8
1
1.2""")
crv = Curve([medges.NakedEdges, medges.InteriorEdges])
show = Show(G=clean)
lng = ListLength(List=crv)
lng_2 = ListLength(List=panel)
# Use Alt+left mouse button
# to drag vertices in Rhino
grab = Grab(On=True, Strength=1, Range=3)  # -> Grab, Anchors
reset = Button()
subtraction = Subtraction(A=lng_2, B="1")
# Selection from these lengths by random index.
panel_2 = Panel("0")
dom = ConstructDomain(DomainStart=panel_2, DomainEnd=subtraction)
random = Random(Range=dom, Number=lng, Seed=2, Integers=True)
item = ListItem(List=panel, Index=random, Wrap=True)
length_line = LengthLine(Line=crv, Length=item, Strength=10)
solver = Solver(GoalObjects=[grab.Grab, show, length_line], Reset=reset, Threshold=1e-15, Tolerance=0.01, On=True)  # -> I, V, O
panel_3 = Panel(solver.O)
