# Grasshopper definition simple_4bar_linkage.gh (Grasshopper 1.0.8)

crv = Curve([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])

# ---- group: This fixes some chosen vertices in place.
pt = Point([Point(16, 11, 0), Point(25, 13, 0)])
anchor = Anchor(Point=pt, Strength=10000)

# ---- group: This keeps all vertices on the XY plane
explode = Explode(Curve=crv, Recursive=True)  # -> Segments, Vertices
cullpt = CullDuplicates(Points=flatten(explode.Vertices), Tolerance=0.1, CullMode=3)  # -> Points, Indices, Valence
onplane = OnPlane(Points=cullpt.Points, Plane=PlaneXY(0, 0, 0), Strength=1)

# ---- group: this maintains the lengths of the line segments
length_line = LengthLine(Line=crv, Strength=10)

# ----
grab = Grab(On=True, Strength=1, Range=3)
solver = Solver(GoalObjects=[length_line, anchor, onplane, grab], Reset=Button(), Threshold=1e-15, Tolerance=0.01, On=True)  # -> I, V, O
