# Grasshopper definition directional_stiffness2.gh (Grasshopper 0.9.76)
# plug-ins: Kangaroo Components, Kangaroo2 Components

mesh = Mesh(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)
demesh = DeconstructMesh(Mesh=mesh)  # -> Vertices, Faces, Colours, Normals
brep = Brep(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)
hingepoints = HingePoints(Mesh=mesh)  # -> _1, _2, _3, _4
spc = SolidPointCollide(Points=demesh.Vertices, Solid=brep, Interior=False, Unidirectional=True, Strength=1)
Z = UnitZ(Factor="-0.001")
foldangle = FoldAngle(P1=hingepoints._1, P2=hingepoints._2, P3=hingepoints._3, P4=hingepoints._4)
medges = MeshEdges(Mesh=mesh)  # -> NakedEdges, InteriorEdges, NonManifoldEdges
load = Load(Point=demesh.Vertices, ForceVector=Z)
multiplication = Multiplication(A=foldangle, B=Slider(1, range=0..1))
show = Show(G=mesh)
md_slider = MDSlider(
    slider_value=Point(0, 0.5219514428, 0.5),
    SliderMode=0,
    x_domain=Domain(-1, 1),
    y_domain=Domain(-1, 1),
    z_domain=Domain(0, 1))
length_line = LengthLine(Line=[medges.NakedEdges, medges.InteriorEdges], Strength=1)
X = UnitX(Factor=1)
vec2pt = Vector2Pt(PointA=hingepoints._1, PointB=hingepoints._2, Unitize=False)  # -> Vector, Length
neg = Negative(Value=md_slider)
angle = Angle(VectorA=vec2pt.Vector, VectorB=md_slider)  # -> Angle, Reflex
angle_2 = Angle(VectorA=vec2pt.Vector, VectorB=neg)  # -> Angle, Reflex
min = Minimum(A=angle.Angle, B=angle_2.Angle)
grab = Grab(On=True, Strength=1, Range=3)  # -> Grab, Anchors
multiplication_2 = Multiplication(A=min, B=4)
hinge = Hinge(
    FoldStart=hingepoints._1,
    FoldEnd=hingepoints._2,
    Tip1=hingepoints._3,
    Tip2=hingepoints._4,
    RestAngle=multiplication,
    Strength=multiplication_2)
floor = Floor(Strength=1)
solver = Solver(
    GoalObjects=[length_line, hinge, show, grab.Grab, spc, load, floor],
    Reset=Button(),
    Threshold=1e-15,
    Tolerance=0.01,
    On=Toggle(False))  # -> I, V, O
item = ListItem(List=solver.O, Index=0, Wrap=True)
medges_2 = MeshEdges(Mesh=item)  # -> NakedEdges, InteriorEdges, NonManifoldEdges
preview = CustomPreview(
    Geometry=item,
    Shader={ambient=RGB(128, 128, 128), diffuse=RGB(0, 192, 192), emission=RGB(0, 0, 0), shine=0.5, specular=RGB(255, 255, 255), transparency=0})
