# Grasshopper definition mesh_flatten.gh (Grasshopper 0.9.76)
# plug-ins: Kangaroo2 Components

mesh = Mesh(<mesh referenced from the Rhino model>)
Z = UnitZ(Factor=-0.01)
demesh = DeconstructMesh(Mesh=mesh)  # -> Vertices, Faces, Colours, Normals
hingepoints = HingePoints(Mesh=mesh)  # -> _1, _2, _3, _4
medges = MeshEdges(Mesh=mesh)  # -> NakedEdges, InteriorEdges, NonManifoldEdges
load = Load(Point=demesh.Vertices, ForceVector=Z)
hinge = Hinge(FoldStart=hingepoints._1, FoldEnd=hingepoints._2, Tip1=hingepoints._3, Tip2=hingepoints._4, RestAngle=0, Strength=1)
grab = Grab(On=True, Strength=1, Range=3)  # -> Grab, Anchors
length_line = LengthLine(Line=[medges.NakedEdges, medges.InteriorEdges], Strength=Slider(0.021, range=0..1))
show = Show(G=mesh)
floor = Floor(Strength=1)
solver = Solver(
    GoalObjects=[length_line, hinge, show, grab.Grab, floor, load],
    Reset=Button(),
    Threshold=1e-15,
    Tolerance=0.01,
    On=Toggle(False))  # -> I, V, O
data = Data(solver.O)
mesh_2 = Mesh(data)
preview = CustomPreview(
    Geometry=mesh_2,
    Shader={ambient=RGB(128, 128, 128), diffuse=RGB(0, 192, 0), emission=RGB(76, 32, 54), shine=0.5, specular=RGB(255, 255, 255), transparency=0})
medges_2 = MeshEdges(Mesh=mesh_2)  # -> NakedEdges, InteriorEdges, NonManifoldEdges
