# Grasshopper definition polygonassemble.gh (Grasshopper 0.9.76)
# plug-ins: Kangaroo2 Components

mesh = Mesh([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])
medges = MeshEdges(Mesh=mesh)  # -> NakedEdges, InteriorEdges, NonManifoldEdges
grab = Grab(On=True, Strength=1, Range=3)  # -> Grab, Anchors
show = Show(G=mesh)
demesh = DeconstructMesh(Mesh=mesh)  # -> Vertices, Faces, Colours, Normals
length_line = LengthLine(Line=medges.NakedEdges, Strength=100)
ms = MagnetSnap(Points=flatten(demesh.Vertices), Range=Slider(2.5, range=0..3), Strength=10)
solver = Solver(GoalObjects=[length_line, ms, show, grab.Grab], Reset=Button(), Threshold=1e-15, Tolerance=0.01, On=True)  # -> I, V, O
data = Data(solver.O)
