# Grasshopper definition bending_membrane_edge.gh (Grasshopper 0.9.76)
# plug-ins: Kangaroo2 Components

mesh_plane = MeshPlane(Boundary={Plane=PlaneXY(0, 0, 0), Size=Domain2(u=-10..10, v=-10..10)}, WidthCount=10, HeightCount=10)  # -> Mesh, Area
triangulate = Triangulate(Mesh=mesh_plane.Mesh)  # -> Mesh, Count
mesh_edges = MeshEdges(Mesh=triangulate.Mesh)  # -> NakedEdges, InteriorEdges, NonManifoldEdges
join_curves = JoinCurves(Curves=mesh_edges.NakedEdges, Preserve=False)
length_line = LengthLine(Line=mesh_edges.NakedEdges, Strength=100)
explode = Explode(Curve=join_curves, Recursive=True)  # -> Segments, Vertices
length_line_2 = LengthLine(Line=mesh_edges.InteriorEdges, Length="1", Strength=0.01)
shift_list = ShiftList(List=explode.Segments, Shift=1, Wrap=True)
grab = Grab(On=True, Strength=1, Range=3)  # -> Grab, Anchors
angle = Angle(LineA=explode.Segments, LineB=shift_list, RestAngle="0", Strength=2)
solver = Solver(GoalObjects=[length_line_2, length_line, angle, grab.Grab], Reset=Button(), Threshold=1e-15, Tolerance=0.01, On=True)  # -> I, V, O
