# Grasshopper definition tensile_cone.gh (Grasshopper 0.9.76)
# plug-ins: Kangaroo Components, Kangaroo2 Components

mesh = Mesh(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)
combine_clean = CombineClean(Meshes=mesh)
refine = Refine(Mesh=combine_clean, Level=Slider(3, range=0..11))
mesh_2 = Mesh(refine)
medges = MeshEdges(Mesh=mesh_2)  # -> NakedEdges, InteriorEdges, NonManifoldEdges
join_curves = JoinCurves(Curves=medges.NakedEdges, Preserve=False)
strength = Strength(10)
point = Point([Point(65, 20, 0), Point(65, 50, 0), Point(35, 50, 0), Point(35, 20, 0)])
list_item = ListItem(List=join_curves, Index=0, Wrap=True)  # -> Item, Item1
anchor = Anchor(Point=point, Strength=10000)
length_line = LengthLine(Line=medges.InteriorEdges, Length=0, Strength=1)
length_line_2 = LengthLine(Line=medges.NakedEdges, Length=Slider(0, range=0..1), Strength=strength)
curve = Curve(list_item.Item1)
explode = Explode(Curve=curve, Recursive=True)  # -> Segments, Vertices
curve_2 = Curve(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)
end_points = EndPoints(Curve=explode.Segments)  # -> Start, End
oncurve = OnCurve(Points=end_points.Start, Curve=curve_2, Strength=Slider(85.474, range=0..201))
solver = Solver(
    GoalObjects=[anchor, length_line, length_line_2, oncurve],
    Reset=Button(),
    Threshold=1e-15,
    Tolerance=0.01,
    On=Toggle(True))  # -> I, V, O
data = Data(solver.O)
