# Grasshopper definition tensile_saddle.gh (Grasshopper 0.9.76)
# plug-ins: Kangaroo2 Components

mesh = Mesh(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)
diag = Diagonalize(Mesh=mesh)
mc = MeshCorners(Mesh=diag, Angle=2.35619449)
medges = MeshEdges(Mesh=diag)  # -> NakedEdges, InteriorEdges, NonManifoldEdges
pt = Point([Point(5, 20, 6.997349412), Point(20, 20, 0), Point(20, 5, 8.103794634), Point(5, 5, 0)])
anchor = Anchor(Point=mc, Target=pt, Strength=10000)
length_line = LengthLine(Line=medges.NakedEdges, Length=Slider(1, range=0..1), Strength=50)
length_line_2 = LengthLine(Line=medges.InteriorEdges, Length=0, Strength=1)
solver = Solver(GoalObjects=[anchor, length_line_2, length_line], Reset=Button(), Threshold=1e-15, Tolerance=0.01, On=Toggle(True))  # -> I, V, O
