# Grasshopper definition flag.gh (Grasshopper 0.9.76)
# plug-ins: Kangaroo2 Components

pt = Point([Point(5, 0, 15), Point(5, 0, 5)])
mplane = MeshPlane(Boundary={Plane=PlaneXZ(5, 0, 5), Size=Domain2(u=0..15, v=0..10)}, WidthCount=15, HeightCount=10)  # -> Mesh, Area
vec = Vector(Vector(19, 17, 0))
anchor = Anchor(Point=pt, Strength=10000)
multiplication = Multiplication(A=vec, B=Slider(0.045, range=0..1))
tri = Triangulate(Mesh=mplane.Mesh)  # -> Mesh, Count
medges = MeshEdges(Mesh=tri.Mesh)  # -> NakedEdges, InteriorEdges, NonManifoldEdges
show = Show(G=mplane.Mesh)
wind = Wind(Mesh=tri.Mesh, WindVector=multiplication)
smooth = Smooth(M=tri.Mesh, Strength=1)
length_line = LengthLine(Line=[medges.NakedEdges, medges.InteriorEdges], Strength=10)
bouncysolver = BouncySolver(
    GoalObjects=[length_line, show, anchor, wind, smooth],
    Reset=False,
    Threshold=1e-15,
    Tolerance=0.01,
    Damping=0.99,
    Iterations=2,
    On=True)  # -> I, V, O
data = Data(bouncysolver.O)
